# Grasshopper definition Weimar.gh (Grasshopper 1.0.8)

my_plot = GeometryPipeline(
    GroupByLayer=False,
    GroupByType=False,
    IncludeHidden=True,
    IncludeLocked=True,
    LayerFilter="My_Plot",
    NameFilter="*",
    SublayerFiltering=True,
    TypeFilter=4)
terrain = GeometryPipeline(
    GroupByLayer=False,
    GroupByType=False,
    IncludeHidden=True,
    IncludeLocked=True,
    LayerFilter="Weimar::Terrain",
    NameFilter="*",
    SublayerFiltering=True,
    TypeFilter=32)
lake_size = Slider(0.14, range=0.05..0.25)
lake_shift = Slider(0, range=-0.3..0.3)
shore_width = Slider(3, range=1..6)
seed = Slider(7, range=0..100)
lawn_cell = Slider(2, range=0.5..5)
lawn_lift = Slider(0.05, range=0.01..0.2)
path_width = Slider(3, range=1.5..6)
edge_walk_inset = Slider(4, range=2..12)
shore_to_promenade = Slider(4, range=1..10)
path_lift = Slider(0.1, range=0.05..0.3)
tree_count = Slider(140, range=10..400)
tree_spacing = Slider(7, range=3..15)
bench_spacing = Slider(14, range=6..40)
pier_reach = Slider(0.4, range=0.1..0.8)
bed_lift = Slider(0.15, range=0.05..0.4)
pavilion_angle = Slider(150, range=0..360)
pavilion_radius = Slider(14, range=8..25)
pavilion_height = Slider(7, range=4..12)
oculus_radius = Slider(3.86, range=1.5..7)
oculus_tilt = Slider(1.5, range=0..4)
edge_over_water = Slider(3, range=1.5..6)
reach_over_lake = Slider(0.3, range=0..0.5)
lake_edge_upsweep = Slider(2.5, range=0..6)
shell_thickness = Slider(0.25, range=0.1..0.6)
pavilion_seed = Slider(3, range=0..100)
column_count = Slider(5, range=1..12)
column_flare = Slider(1.4, range=0.3..3)
column_lean = Slider(1.2, range=0..4)
column_seed = Slider(4, range=0..100)
lake = Python3Script(boundary=my_plot, terrain=terrain, size=lake_size, shift=lake_shift, shore=shore_width, seed=seed)  # -> water, shore_mesh, lake, level; inputs boundary: Curve, terrain: Mesh, size: Double, shift: Double, shore: Double, seed: Int32
# ---------- lake: Python ----------
"""Lake: an organic pond in the lowest part of the plot, with a sloping sandy shore.
Inputs: boundary (Curve), terrain (Mesh), size (float, share of plot area),
shift (float, sideways nudge as share of plot width), shore (float, m), seed (int).
Outputs: water, shore_mesh, lake (outer shore outline at z=0), level (water height)."""
import math
import random
import Rhino.Geometry as rg

XY = rg.Plane.WorldXY


def ground(x, y):
    d = rg.Intersect.Intersection.MeshRay(terrain, rg.Ray3d(rg.Point3d(x, y, -1000), rg.Vector3d.ZAxis))
    return d - 1000 if d >= 0 else 0.0


def dist(c, p):
    return p.DistanceTo(c.PointAt(c.ClosestPoint(p)[1]))


rnd = random.Random(seed)
amp = rg.AreaMassProperties.Compute(boundary)
bb = boundary.GetBoundingBox(True)
w = bb.Max.X - bb.Min.X
h = bb.Max.Y - bb.Min.Y
stretch = max(1.0, min(1.5, w / h))
margin = 13.0

# lowest ground away from the plot edge, pulled a little toward the middle of the plot
low, low_z = amp.Centroid, 1e9
for i in range(41):
    for j in range(41):
        p = rg.Point3d(bb.Min.X + w * i / 40, bb.Min.Y + h * j / 40, 0)
        if boundary.Contains(p, XY, 0.01) == rg.PointContainment.Inside and dist(boundary, p) > 15:
            z = ground(p.X, p.Y)
            if z < low_z:
                low, low_z = p, z
cx = low.X + (amp.Centroid.X - low.X) * 0.35 + shift * w
cy = low.Y + (amp.Centroid.Y - low.Y) * 0.35
ph = [rnd.uniform(0, 2 * math.pi) for _ in range(3)]
N = 96


def outline(R, extra):
    # points of the base shape pushed outward by `extra` metres
    rx, ry = R * math.sqrt(stretch), R / math.sqrt(stretch)
    base = []
    for i in range(N):
        t = 2 * math.pi * i / N
        f = 1 + 0.16 * math.cos(t + ph[0]) + 0.10 * math.cos(2 * t + ph[1]) + 0.05 * math.cos(3 * t + ph[2])
        base.append((cx + rx * f * math.cos(t), cy + ry * f * math.sin(t)))
    pts = []
    for i in range(N):
        (x0, y0), (x1, y1) = base[i - 1], base[(i + 1) % N]
        tx, ty = x1 - x0, y1 - y0
        ln = math.hypot(tx, ty)
        x, y = base[i]
        pts.append((x + ty / ln * extra, y - tx / ln * extra))
    return pts


def fits(pts):
    for x, y in pts:
        p = rg.Point3d(x, y, 0)
        if boundary.Contains(p, XY, 0.01) != rg.PointContainment.Inside or dist(boundary, p) < margin:
            return False
    return True


# shrink the lake until its shore stays clear of the plot edge
R = math.sqrt(size * amp.Area / math.pi)
for _ in range(40):
    if fits(outline(R, shore)):
        break
    R *= 0.95

# water just above the highest ground inside the open water, so the terrain never shows through
inner = [(cx + (x - cx) * k, cy + (y - cy) * k) for x, y in outline(R, 0.4 * shore) for k in (1.0, 0.66, 0.33)]
level = max(ground(x, y) for x, y in inner + [(cx, cy)]) + 0.10
depth = 0.8

# rings from the lake bed up to the lawn edge: (share of shore width, height); the shore never dips under the terrain
profile = [(0.0, level - depth), (0.3, level - 0.10), (0.5, level + 0.05), (1.0, None)]
shore_mesh = rg.Mesh()
rings = []
for s, z in profile:
    start = shore_mesh.Vertices.Count
    for x, y in outline(R, s * shore):
        g = ground(x, y) + 0.05
        shore_mesh.Vertices.Add(x, y, g if z is None else max(z, g) if s > 0 else z)
    rings.append(start)
for a, b in zip(rings[:-1], rings[1:]):
    for i in range(N):
        j = (i + 1) % N
        shore_mesh.Faces.AddFace(a + i, b + i, b + j, a + j)
# lake bed, so nothing shows through the water
c = shore_mesh.Vertices.Add(cx, cy, level - depth)
for i in range(N):
    shore_mesh.Faces.AddFace(c, i, (i + 1) % N)
shore_mesh.Normals.ComputeNormals()

water = rg.Mesh()
for x, y in outline(R, 0.4 * shore):
    water.Vertices.Add(x, y, level)
c = water.Vertices.Add(cx, cy, level)
for i in range(N):
    water.Faces.AddFace(c, i, (i + 1) % N)
water.Normals.ComputeNormals()

outer = [rg.Point3d(x, y, 0) for x, y in outline(R, shore)]
lake = rg.Curve.CreateInterpolatedCurve(outer + [outer[0]], 3, rg.CurveKnotStyle.ChordPeriodic)
# ---------- end lake ----------
lawn = Python3Script(boundary=my_plot, lake=lake.lake, terrain=terrain, cell=lawn_cell, lift=lawn_lift)  # -> lawn; inputs boundary: Curve, lake: Curve, terrain: Mesh, cell: Double, lift: Double
# ---------- lawn: Python ----------
"""Lawn: the plot draped on the terrain, with a hole where the lake is.
Inputs: boundary (Curve), lake (Curve), terrain (Mesh), cell (float, m), lift (float, m above terrain).
Output: lawn."""
import Rhino.Geometry as rg


def flat(c):
    c = c.DuplicateCurve()
    c.Transform(rg.Transform.PlanarProjection(rg.Plane.WorldXY))
    return c


curves = [flat(boundary)]
if lake:
    curves.append(flat(lake))
breps = rg.Brep.CreatePlanarBreps(curves, 0.01)

mp = rg.MeshingParameters()
mp.SimplePlanes = False
mp.MaximumEdgeLength = cell
mp.MinimumEdgeLength = cell * 0.25
mp.GridAspectRatio = 1.5

lawn = rg.Mesh()
for b in breps:
    for m in rg.Mesh.CreateFromBrep(b, mp):
        lawn.Append(m)
for i in range(lawn.Vertices.Count):
    v = lawn.Vertices[i]
    d = rg.Intersect.Intersection.MeshRay(terrain, rg.Ray3d(rg.Point3d(v.X, v.Y, -1000), rg.Vector3d.ZAxis))
    if d >= 0:
        lawn.Vertices.SetVertex(i, v.X, v.Y, d - 1000 + lift)
lawn.FaceNormals.ComputeFaceNormals()
if lawn.FaceNormals[0].Z < 0:
    lawn.Flip(True, True, True)
lawn.Normals.ComputeNormals()
# ---------- end lawn ----------
paths = Python3Script(
    boundary=my_plot,
    lake=lake.lake,
    terrain=terrain,
    width=path_width,
    edge=edge_walk_inset,
    gap=shore_to_promenade,
    lift=path_lift,
    seed=seed)  # -> paths, centerlines, promenade; inputs boundary: Curve, lake: Curve, terrain: Mesh, width: Double, edge: Double, gap: Double, lift: Double, seed: Int32
# ---------- paths: Python ----------
"""Paths: a promenade around the lake, a walk along the plot edge, and curved
paths from each side of the plot into the park.
Inputs: boundary (Curve), lake (Curve), terrain (Mesh), width (float, m),
edge (float, m from plot edge to the outer walk), gap (float, m from shore to promenade),
lift (float, m above terrain), seed (int).
Outputs: paths (mesh), centerlines, promenade."""
import math
import random
import Rhino.Geometry as rg

rnd = random.Random(seed)
XY = rg.Plane.WorldXY


def ground(x, y):
    d = rg.Intersect.Intersection.MeshRay(terrain, rg.Ray3d(rg.Point3d(x, y, -1000), rg.Vector3d.ZAxis))
    return d - 1000 if d >= 0 else 0.0


def area(c):
    return rg.AreaMassProperties.Compute(c).Area


def offset(c, d):
    # positive d grows the closed curve, negative shrinks it
    a0 = area(c)
    for s in (1, -1):
        res = c.Offset(XY, s * abs(d), 0.01, rg.CurveOffsetCornerStyle.Round)
        if res and len(res) == 1 and res[0].IsClosed and (area(res[0]) > a0) == (d > 0):
            return res[0]
    return None


def ribbon(c, z):
    n = max(8, int(c.GetLength() / 0.75))
    ts = list(c.DivideByCount(n, True))
    m = rg.Mesh()
    for t in ts:
        p = c.PointAt(t)
        tg = c.TangentAt(t)
        left = rg.Vector3d(-tg.Y, tg.X, 0)
        left.Unitize()
        for s in (-1, 1):
            q = p + left * (s * width / 2)
            m.Vertices.Add(q.X, q.Y, ground(q.X, q.Y) + z)
    segs = len(ts) if c.IsClosed else len(ts) - 1
    for i in range(segs):
        j = (i + 1) % len(ts)
        m.Faces.AddFace(2 * i, 2 * j, 2 * j + 1, 2 * i + 1)
    m.Normals.ComputeNormals()
    return m


plot = boundary.DuplicateCurve()
plot.Transform(rg.Transform.PlanarProjection(XY))

promenade = offset(lake, gap + width / 2)
corner = 8.0
outer_walk = offset(offset(plot, -(edge + corner)), corner)

# entrances: the middle of every long side of the plot
connectors = []
ok, poly = plot.TryGetPolyline()
sides = [poly.SegmentAt(i) for i in range(poly.SegmentCount)] if ok else []
for seg in sides:
    if seg.Length < 20:
        continue
    e = seg.PointAt(0.5 + rnd.uniform(-0.12, 0.12))
    q = promenade.PointAt(promenade.ClosestPoint(e)[1])
    v = q - e
    side = rg.Vector3d(-v.Y, v.X, 0)
    side.Unitize()
    mid = e + v * 0.5 + side * (v.Length * rnd.uniform(0.12, 0.22) * rnd.choice((-1, 1)))
    connectors.append(rg.Curve.CreateInterpolatedCurve([e, mid, q], 3))
# short diagonal paths from two opposite corners onto the outer walk
if ok:
    for k in (0, 2):
        cpt = poly[k]
        q = outer_walk.PointAt(outer_walk.ClosestPoint(cpt)[1])
        connectors.append(rg.LineCurve(cpt, q))

centerlines = [promenade, outer_walk] + connectors
paths = rg.Mesh()
paths.Append(ribbon(promenade, lift))
paths.Append(ribbon(outer_walk, lift))
for c in connectors:
    paths.Append(ribbon(c, lift + 0.03))
# ---------- end paths ----------
benches = Python3Script(
    promenade=paths.promenade,
    lake=lake.lake,
    centerlines=paths.centerlines,
    terrain=terrain,
    step=bench_spacing,
    width=path_width)  # -> benches; inputs promenade: Curve, lake: Curve, centerlines: list of Curve, terrain: Mesh, step: Double, width: Double
# ---------- benches: Python ----------
"""Benches: along the lake promenade, on the lake side, facing the water.
Inputs: promenade (Curve), lake (Curve), centerlines (list of Curve), terrain (Mesh),
step (float, m between benches), width (float, path width).
Output: benches (closed boxes: seat, backrest, two legs each)."""
import Rhino.Geometry as rg

XY = rg.Plane.WorldXY


def ground(x, y):
    d = rg.Intersect.Intersection.MeshRay(terrain, rg.Ray3d(rg.Point3d(x, y, -1000), rg.Vector3d.ZAxis))
    return d - 1000 if d >= 0 else 0.0


def dist(c, p):
    return p.DistanceTo(c.PointAt(c.ClosestPoint(p)[1]))


def box(pl, x0, x1, y0, y1, z0, z1):
    return rg.Box(pl, rg.Interval(x0, x1), rg.Interval(y0, y1), rg.Interval(z0, z1)).ToBrep()


benches = []
for t in promenade.DivideByLength(step, True) or []:
    p = promenade.PointAt(t)
    tg = promenade.TangentAt(t)
    n = rg.Vector3d(-tg.Y, tg.X, 0)
    n.Unitize()
    if dist(lake, p + n) > dist(lake, p - n):
        n = -n
    c = p + n * (width / 2 + 0.9)
    if any(dist(cl, c) < width / 2 + 0.5 for cl in centerlines):
        continue
    pl = rg.Plane(rg.Point3d(c.X, c.Y, ground(c.X, c.Y)), tg, n)
    benches += [
        box(pl, -0.9, 0.9, -0.25, 0.25, 0.40, 0.47),    # seat
        box(pl, -0.9, 0.9, -0.30, -0.24, 0.47, 0.90),   # backrest, on the path side
        box(pl, -0.80, -0.70, -0.22, 0.22, -0.05, 0.40),
        box(pl, 0.70, 0.80, -0.22, 0.22, -0.05, 0.40),
    ]
# ---------- end benches ----------
pier = Python3Script(
    lake=lake.lake,
    promenade=paths.promenade,
    boundary=my_plot,
    terrain=terrain,
    level=lake.level,
    reach=pier_reach,
    width=path_width)  # -> pier; inputs lake: Curve, promenade: Curve, boundary: Curve, terrain: Mesh, level: Double, reach: Double, width: Double
# ---------- pier: Python ----------
"""Pier: a timber deck from the promenade out over the water, ending in a square platform.
Inputs: lake (Curve), promenade (Curve), boundary (Curve), terrain (Mesh), level (float, water height),
reach (float, share of the way to the lake centre), width (float, path width).
Output: pier (closed boxes: walkway and platform)."""
import Rhino.Geometry as rg


def ground(x, y):
    d = rg.Intersect.Intersection.MeshRay(terrain, rg.Ray3d(rg.Point3d(x, y, -1000), rg.Vector3d.ZAxis))
    return d - 1000 if d >= 0 else 0.0


# start on the shore closest to the middle of the plot's south side
centre = rg.AreaMassProperties.Compute(lake).Centroid
bb = boundary.GetBoundingBox(True)
south = rg.Point3d(centre.X, bb.Min.Y, 0)
s = lake.PointAt(lake.ClosestPoint(south)[1])
d = centre - s
d.Z = 0
run = d.Length * reach
d.Unitize()
back = s.DistanceTo(promenade.PointAt(promenade.ClosestPoint(s)[1])) - width / 2 - 0.05
top = max(level + 0.45, ground(s.X, s.Y) + 0.15)
pl = rg.Plane(rg.Point3d(s.X, s.Y, top), d, rg.Vector3d.CrossProduct(rg.Vector3d.ZAxis, d))
pier = [
    rg.Box(pl, rg.Interval(-back, run), rg.Interval(-1.25, 1.25), rg.Interval(-0.2, 0)).ToBrep(),
    rg.Box(pl, rg.Interval(run, run + 6), rg.Interval(-3, 3), rg.Interval(-0.2, 0)).ToBrep(),
]
# ---------- end pier ----------
flower_beds = Python3Script(centerlines=paths.centerlines, boundary=my_plot, terrain=terrain, width=path_width, lift=bed_lift)  # -> beds; inputs centerlines: list of Curve, boundary: Curve, terrain: Mesh, width: Double, lift: Double
# ---------- flower_beds: Python ----------
"""Flower beds: oval beds on both sides of each path where it enters the park.
Inputs: centerlines (list of Curve), boundary (Curve), terrain (Mesh), width (float, path width),
lift (float, m above terrain).
Output: beds."""
import math
import Rhino.Geometry as rg

XY = rg.Plane.WorldXY


def ground(x, y):
    d = rg.Intersect.Intersection.MeshRay(terrain, rg.Ray3d(rg.Point3d(x, y, -1000), rg.Vector3d.ZAxis))
    return d - 1000 if d >= 0 else 0.0


def dist(c, p):
    return p.DistanceTo(c.PointAt(c.ClosestPoint(p)[1]))


def oval(c, ax, a, b, n=24):
    m = rg.Mesh()
    ay = rg.Vector3d(-ax.Y, ax.X, 0)
    for i in range(n):
        t = 2 * math.pi * i / n
        q = c + ax * (a * math.cos(t)) + ay * (b * math.sin(t))
        m.Vertices.Add(q.X, q.Y, ground(q.X, q.Y) + lift)
    mid = m.Vertices.Add(c.X, c.Y, ground(c.X, c.Y) + lift)
    for i in range(n):
        m.Faces.AddFace(mid, i, (i + 1) % n)
    m.Normals.ComputeNormals()
    return m


beds = rg.Mesh()
for cl in centerlines:
    # just inside the outer walk
    if cl.IsClosed or cl.GetLength() < 20:
        continue
    ok, t = cl.LengthParameter(11.0)
    p = cl.PointAt(t)
    tg = cl.TangentAt(t)
    side = rg.Vector3d(-tg.Y, tg.X, 0)
    side.Unitize()
    for s in (-1, 1):
        c = p + side * (s * (width / 2 + 2.6))
        if boundary.Contains(c, XY, 0.01) != rg.PointContainment.Inside or dist(boundary, c) < 2.5:
            continue
        if any(dist(o, c) < width / 2 + 2.4 for o in centerlines if o is not cl):
            continue
        beds.Append(oval(c, tg, 3.2, 1.8))
# ---------- end flower_beds ----------
pavilion = Python3Script(
    lake=lake.lake,
    centerlines=paths.centerlines,
    terrain=terrain,
    level=lake.level,
    width=path_width,
    angle=pavilion_angle,
    radius=pavilion_radius,
    height=pavilion_height,
    opening=oculus_radius,
    tilt=oculus_tilt,
    lift=edge_over_water,
    upsweep=lake_edge_upsweep,
    asym=reach_over_lake,
    thickness=shell_thickness,
    seed=pavilion_seed)  # -> shell, footprint; inputs lake: Curve, centerlines: list of Curve, terrain: Mesh, level: Double, width: Double, angle: Double, radius: Double, height: Double, opening: Double, tilt: Double, lift: Double, upsweep: Double, asym: Double, thickness: Double, seed: Int32
# ---------- pavilion: Python ----------
"""Pavilion: a thin organic shell that grows out of the ground on the shore and sweeps up
over part of the lake, with a large opening (oculus) tilted to the south to let the sun in.
Inputs: lake (Curve), centerlines (list of Curve, the paths), terrain (Mesh), level (float, water height), width (float, path width),
angle (float, degrees: where on the shore it stands, 0 = east, 90 = north),
radius (float, m), height (float, m at the oculus rim), opening (float, oculus radius m),
tilt (float, m the oculus rim rises from south to north), lift (float, m of the free edge above the water),
upsweep (float, m the edge rises further on the lake side),
asym (float, 0-0.5: how far the shell reaches out over the lake), thickness (float, m), seed (int).
Outputs: shell (closed mesh), footprint (outer edge at z=0, for keeping trees away)."""
import math
import random
import Rhino.Geometry as rg

rnd = random.Random(seed)


def ground(x, y):
    d = rg.Intersect.Intersection.MeshRay(terrain, rg.Ray3d(rg.Point3d(x, y, -1000), rg.Vector3d.ZAxis))
    return d - 1000 if d >= 0 else 0.0


def adiff(a, b):
    return math.atan2(math.sin(a - b), math.cos(a - b))


# stand on the shore in the chosen direction from the lake centre
centre = rg.AreaMassProperties.Compute(lake).Centroid
a = math.radians(angle)
far = centre + rg.Vector3d(math.cos(a), math.sin(a), 0) * 500
hits = rg.Intersect.Intersection.CurveCurve(lake, rg.LineCurve(centre, far), 0.01, 0.01)
shore = hits[0].PointA if hits.Count else centre
to_lake = centre - shore
to_lake.Unitize()
a_lake = math.atan2(to_lake.Y, to_lake.X)
a_land = a_lake + math.pi
# oculus sits just over the water
O = shore + to_lake * (radius * 0.2)

ph = [rnd.uniform(0, 2 * math.pi) for _ in range(4)]
# the one foot where the shell grows out of the land; the lake side is held up by the columns
roots = [(a_land, 0.55)]


def base_rout(t):
    return radius * (1 + asym * math.cos(t - a_lake) + 0.10 * math.cos(2 * t + ph[2]) + 0.06 * math.cos(3 * t + ph[3]))


def foot_ok(t, r):
    # a foot either lands before the first path it would meet, or well past every path it crosses
    d = rg.Vector3d(math.cos(t), math.sin(t), 0)
    foot = O + d * r
    ray = rg.LineCurve(O, foot)
    for c in centerlines:
        if foot.DistanceTo(c.PointAt(c.ClosestPoint(foot)[1])) < width / 2 + 3.5:
            return False
        for e in rg.Intersect.Intersection.CurveCurve(c, ray, 0.01, 0.01):
            if r - O.DistanceTo(e.PointA) < width / 2 + 3.5:
                return False
    return True


# move each foot to the nearest spot (in angle and distance) that keeps the paths walkable
feet = []
for ra, w in roots:
    r0 = base_rout(ra)
    spots = sorted((abs(0.5 * j - r0) + 8 * abs(0.05 * i), ra + 0.05 * i, 0.5 * j)
                   for i in range(-10, 11) for j in range(int(radius), int(radius * 3.6)))
    best = next(((t, r) for _, t, r in spots if foot_ok(t, r)), (ra, r0))
    feet.append((best[0], w, best[1]))
M, S = 120, 28
top = []
for i in range(M):
    t = 2 * math.pi * i / M
    d = rg.Vector3d(math.cos(t), math.sin(t), 0)
    ro = opening * (1 + 0.18 * math.cos(2 * t + ph[0]) + 0.08 * math.cos(3 * t + ph[1]))
    rout = base_rout(t)
    for ra, w, r_foot in feet:
        k_one = math.exp(-(adiff(t, ra) / w) ** 2)
        rout += (r_foot - rout) * min(1.0, 2 * k_one)
    k = max(math.exp(-(adiff(t, ra) / w) ** 2) for ra, w, _ in feet)
    p0 = O + d * ro
    p1 = O + d * rout
    z_rim = level + height + tilt / 2 * math.sin(t)
    g = max(ground(p1.X, p1.Y), level)
    # the edge sweeps up toward the lake, and keeps walking height where it hangs over land
    z_free = max(level + lift + upsweep * max(0.0, math.cos(t - a_lake)) ** 1.5, g + 2.8 + thickness)
    z_edge = z_free * (1 - k) + (g - 0.4) * k
    row = []
    for j in range(S + 1):
        s = j / S
        q = p0 + (p1 - p0) * s
        # a gentle arch between the oculus rim and the edge; the feet bend down steeply
        z = z_rim + (z_edge - z_rim) * s ** (1 + 1.5 * k) + height * 0.22 * math.sin(math.pi * s) * (1 - 0.6 * k)
        # keep walking height over land, except where the shell bends down into a foot
        gq = ground(q.X, q.Y)
        if gq > level:
            relax = min(1.0, max(0.0, (k - 0.3) / 0.4)) * s * s
            z = max(z, gq + (2.8 + thickness) * (1 - relax))
        row.append(rg.Point3d(q.X, q.Y, z))
    top.append(row)

up = rg.Mesh()
for row in top:
    for p in row:
        up.Vertices.Add(p)
for i in range(M):
    n = (i + 1) % M
    for j in range(S):
        up.Faces.AddFace(i * (S + 1) + j, i * (S + 1) + j + 1, n * (S + 1) + j + 1, n * (S + 1) + j)
up.Normals.ComputeNormals()

# underside: the top pushed in by the thickness, faces turned the other way
bottom = [[top[i][j] - rg.Vector3d(up.Normals[i * (S + 1) + j]) * thickness for j in range(S + 1)] for i in range(M)]
down = rg.Mesh()
for row in bottom:
    for p in row:
        down.Vertices.Add(p)
for i in range(M):
    n = (i + 1) % M
    for j in range(S):
        down.Faces.AddFace(i * (S + 1) + j, n * (S + 1) + j, n * (S + 1) + j + 1, i * (S + 1) + j + 1)


def rim(j, outward):
    # band joining top and underside along one edge, with its own vertices so the corner stays sharp
    m = rg.Mesh()
    for i in range(M):
        m.Vertices.Add(top[i][j])
        m.Vertices.Add(bottom[i][j])
    for i in range(M):
        n = (i + 1) % M
        if outward:
            m.Faces.AddFace(2 * i, 2 * i + 1, 2 * n + 1, 2 * n)
        else:
            m.Faces.AddFace(2 * i, 2 * n, 2 * n + 1, 2 * i + 1)
    return m


shell = rg.Mesh()
for part in (up, down, rim(S, True), rim(0, False)):
    shell.Append(part)
shell.Normals.ComputeNormals()

edge = [rg.Point3d(row[S].X, row[S].Y, 0) for row in top]
footprint = rg.Curve.CreateInterpolatedCurve(edge + [edge[0]], 3, rg.CurveKnotStyle.ChordPeriodic)
# ---------- end pavilion ----------
trees = Python3Script(
    boundary=my_plot,
    lake=lake.lake,
    centerlines=paths.centerlines,
    avoid=pavilion.footprint,
    terrain=terrain,
    count=tree_count,
    spacing=tree_spacing,
    width=path_width,
    seed=seed)  # -> trunks, leafy_dark, leafy_light, conifers, blossom; inputs boundary: Curve, lake: Curve, centerlines: list of Curve, avoid: list of Curve, terrain: Mesh, count: Int32, spacing: Double, width: Double, seed: Int32
# ---------- trees: Python ----------
"""Trees: a dense belt along the plot edge, a few groves and loose single trees,
kept clear of the lake and the paths.
Inputs: boundary (Curve), lake (Curve), centerlines (list of Curve), avoid (list of Curve, areas kept free
such as the pavilion), terrain (Mesh), count (int), spacing (float, m between crowns), width (float, path width), seed (int).
Outputs: trunks, leafy_dark, leafy_light, conifers, blossom."""
import math
import random
import Rhino.Geometry as rg

rnd = random.Random(seed)
XY = rg.Plane.WorldXY


def ground(x, y):
    d = rg.Intersect.Intersection.MeshRay(terrain, rg.Ray3d(rg.Point3d(x, y, -1000), rg.Vector3d.ZAxis))
    return d - 1000 if d >= 0 else 0.0


def dist(c, p):
    return p.DistanceTo(c.PointAt(c.ClosestPoint(p)[1]))


def free(p):
    if boundary.Contains(p, XY, 0.01) != rg.PointContainment.Inside or dist(boundary, p) < 2.0:
        return False
    if lake.Contains(p, XY, 0.01) == rg.PointContainment.Inside or dist(lake, p) < 2.5:
        return False
    for c in avoid or []:
        if c.Contains(p, XY, 0.01) == rg.PointContainment.Inside or dist(c, p) < 3.0:
            return False
    return all(dist(c, p) > width / 2 + 1.8 for c in centerlines)


def cone(base, r, h, n=14):
    m = rg.Mesh()
    for i in range(n):
        t = 2 * math.pi * i / n
        m.Vertices.Add(base.X + r * math.cos(t), base.Y + r * math.sin(t), base.Z)
    apex = m.Vertices.Add(base.X, base.Y, base.Z + h)
    mid = m.Vertices.Add(base)
    for i in range(n):
        j = (i + 1) % n
        m.Faces.AddFace(i, j, apex)
        m.Faces.AddFace(mid, j, i)
    m.Normals.ComputeNormals()
    return m


bb = boundary.GetBoundingBox(True)


def sample():
    return rg.Point3d(rnd.uniform(bb.Min.X, bb.Max.X), rnd.uniform(bb.Min.Y, bb.Max.Y), 0)


groves = []
for _ in range(2000):
    if len(groves) == 3:
        break
    p = sample()
    if free(p) and dist(boundary, p) > 14 and all(p.DistanceTo(g) > 25 for g in groves):
        groves.append(p)

placed = []
attempts = 0
while len(placed) < count and attempts < count * 120:
    attempts += 1
    p = sample()
    if not free(p):
        continue
    chance = 0.85 if dist(boundary, p) < 9 else 0.12
    if any(p.DistanceTo(g) < 11 for g in groves):
        chance = max(chance, 0.7)
    if rnd.random() > chance:
        continue
    r = rnd.uniform(2.2, 4.2)
    if any(p.DistanceTo(q) < spacing * (r + rq) / 6.4 for q, rq in placed):
        continue
    placed.append((p, r))

trunks = []
leafy_dark, leafy_light, conifers, blossom = rg.Mesh(), rg.Mesh(), rg.Mesh(), rg.Mesh()
for p, r in placed:
    g = ground(p.X, p.Y)
    kind = rnd.random()
    if kind < 0.15:
        # conifer: short trunk under a tall cone
        th = 1.2
        trunks.append(rg.Cylinder(rg.Circle(rg.Plane(rg.Point3d(p.X, p.Y, g), rg.Vector3d.ZAxis), 0.07 * r), th + 0.5).ToBrep(True, True))
        conifers.Append(cone(rg.Point3d(p.X, p.Y, g + th), r * 0.8, r * rnd.uniform(3.0, 3.8)))
        continue
    th = r * rnd.uniform(0.9, 1.3) + 0.8
    trunks.append(rg.Cylinder(rg.Circle(rg.Plane(rg.Point3d(p.X, p.Y, g), rg.Vector3d.ZAxis), 0.08 * r), th + r * 0.5).ToBrep(True, True))
    c = rg.Point3d(p.X, p.Y, g + th + r * 0.85)
    crown = rg.Mesh.CreateFromSphere(rg.Sphere(c, r), 16, 12)
    crown.Transform(rg.Transform.Scale(rg.Plane(c, rg.Vector3d.ZAxis), 1.0, 1.0, rnd.uniform(0.85, 1.3)))
    crown.Normals.ComputeNormals()
    target = blossom if kind > 0.9 else (leafy_dark if kind < 0.55 else leafy_light)
    target.Append(crown)
# ---------- end trees ----------
columns = Python3Script(
    shell=pavilion.shell,
    footprint=pavilion.footprint,
    lake=lake.lake,
    pier=pier,
    level=lake.level,
    shore=shore_width,
    count=column_count,
    flare=column_flare,
    lean=column_lean,
    seed=column_seed)  # -> columns; inputs shell: Mesh, footprint: Curve, lake: Curve, pier: list of Brep, level: Double, shore: Double, count: Int32, flare: Double, lean: Double, seed: Int32
# ---------- columns: Python ----------
"""Columns: slender organic columns that rise out of the lake, lean outward a little
and flare like trumpets into the underside of the pavilion shell.
Inputs: shell (Mesh), footprint (Curve), lake (Curve), pier (list of Brep), level (float, water height),
shore (float, shore width), count (int), flare (float, m radius where a column meets the shell),
lean (float, m the top leans toward the shell edge), seed (int).
Output: columns (closed meshes)."""
import math
import random
import Rhino.Geometry as rg

rnd = random.Random(seed)
XY = rg.Plane.WorldXY


def underside(x, y):
    d = rg.Intersect.Intersection.MeshRay(shell, rg.Ray3d(rg.Point3d(x, y, level), rg.Vector3d.ZAxis))
    return level + d if d >= 0 else None


def dist(c, p):
    return p.DistanceTo(c.PointAt(c.ClosestPoint(p)[1]))


# candidate spots: open water under the outer part of the shell, clear of the pier and the oculus
pier_boxes = [b.GetBoundingBox(True) for b in pier or []]
for bb in pier_boxes:
    bb.Inflate(1.5)
fb = footprint.GetBoundingBox(True)
spots = []
for i in range(60):
    for j in range(60):
        p = rg.Point3d(fb.Min.X + (fb.Max.X - fb.Min.X) * i / 59, fb.Min.Y + (fb.Max.Y - fb.Min.Y) * j / 59, 0)
        if footprint.Contains(p, XY, 0.01) != rg.PointContainment.Inside or not 2.0 < dist(footprint, p) < 7.0:
            continue
        if lake.Contains(p, XY, 0.01) != rg.PointContainment.Inside or dist(lake, p) < shore + 0.8:
            continue
        if any(bb.Contains(rg.Point3d(p.X, p.Y, bb.Center.Z)) for bb in pier_boxes):
            continue
        z = underside(p.X, p.Y)
        # every point of the flare must also find the shell above it (not the oculus)
        if z is None or z - level < 2.5 or any(underside(p.X + flare * math.cos(a), p.Y + flare * math.sin(a)) is None
                                               for a in (0, 1.57, 3.14, 4.71)):
            continue
        spots.append(p)

# spread the columns out: each new one as far as possible from those already chosen
chosen = []
if spots:
    cen = rg.AreaMassProperties.Compute(footprint).Centroid
    chosen.append(max(spots, key=lambda p: p.DistanceTo(cen)))
    while len(chosen) < min(count, len(spots)):
        chosen.append(max(spots, key=lambda p: min(p.DistanceTo(q) for q in chosen)))

N, K = 28, 36
columns = []
for base in chosen:
    # lean the top outward, toward the nearest shell edge
    e = footprint.PointAt(footprint.ClosestPoint(base)[1])
    out = e - base
    out.Z = 0
    out.Unitize()
    side = rg.Vector3d(-out.Y, out.X, 0)
    top = base + out * (lean * rnd.uniform(0.6, 1.0))
    bend = rnd.uniform(-0.5, 0.5)
    twist = rnd.uniform(1.5, 3.0) * rnd.choice((-1, 1))
    phase = rnd.uniform(0, 2 * math.pi)
    r0 = rnd.uniform(0.28, 0.38)
    z0 = level - 0.6
    m = rg.Mesh()
    for k in range(K + 1):
        s = k / K
        c = base + (top - base) * s + side * (bend * math.sin(math.pi * s))
        # slim waist, then a trumpet flare into the shell
        r = r0 * (1 - 0.35 * math.sin(math.pi * s * 0.8)) + flare * s ** 4
        for i in range(N):
            a = 2 * math.pi * i / N
            rr = r * (1 + 0.12 * math.cos(5 * a + phase + twist * s))
            x, y = c.X + rr * math.cos(a), c.Y + rr * math.sin(a)
            zt = underside(x, y)
            zt = (zt if zt is not None else underside(c.X, c.Y)) + 0.08
            m.Vertices.Add(x, y, z0 + (zt - z0) * s)
    for k in range(K):
        for i in range(N):
            j = (i + 1) % N
            m.Faces.AddFace(k * N + i, k * N + j, (k + 1) * N + j, (k + 1) * N + i)
    # flat caps with their own vertices, so the edges stay sharp
    for k, down in ((0, True), (K, False)):
        cap = rg.Mesh()
        ring = [m.Vertices.Point3dAt(k * N + i) for i in range(N)]
        for v in ring:
            cap.Vertices.Add(v)
        mid = cap.Vertices.Add(sum(v.X for v in ring) / N, sum(v.Y for v in ring) / N, sum(v.Z for v in ring) / N)
        for i in range(N):
            j = (i + 1) % N
            cap.Faces.AddFace(mid, j, i) if down else cap.Faces.AddFace(mid, i, j)
        m.Append(cap)
    m.Normals.ComputeNormals()
    columns.append(m)
# ---------- end columns ----------
water = ColourSwatch(SwatchColor=RGBA(70, 140, 185, 200))
shore_mesh = ColourSwatch(SwatchColor=RGB(214, 196, 150))
lawn_2 = ColourSwatch(SwatchColor=RGB(112, 158, 82))
paths_2 = ColourSwatch(SwatchColor=RGB(206, 192, 166))
trunks = ColourSwatch(SwatchColor=RGB(98, 74, 56))
leafy_dark = ColourSwatch(SwatchColor=RGB(62, 112, 62))
leafy_light = ColourSwatch(SwatchColor=RGB(128, 170, 84))
conifers = ColourSwatch(SwatchColor=RGB(42, 88, 72))
blossom = ColourSwatch(SwatchColor=RGB(232, 168, 190))
benches_2 = ColourSwatch(SwatchColor=RGB(150, 108, 72))
pier_2 = ColourSwatch(SwatchColor=RGB(168, 128, 88))
beds = ColourSwatch(SwatchColor=RGB(168, 92, 160))
shell = ColourSwatch(SwatchColor=RGB(238, 232, 218))
columns_2 = ColourSwatch(SwatchColor=RGB(238, 232, 218))
preview = CustomPreview(Geometry=lake.water, Material=water)
preview_2 = CustomPreview(Geometry=lake.shore_mesh, Material=shore_mesh)
preview_3 = CustomPreview(Geometry=lawn, Material=lawn_2)
preview_4 = CustomPreview(Geometry=paths.paths, Material=paths_2)
preview_5 = CustomPreview(Geometry=trees.trunks, Material=trunks)
preview_6 = CustomPreview(Geometry=trees.leafy_dark, Material=leafy_dark)
preview_7 = CustomPreview(Geometry=trees.leafy_light, Material=leafy_light)
preview_8 = CustomPreview(Geometry=trees.conifers, Material=conifers)
preview_9 = CustomPreview(Geometry=trees.blossom, Material=blossom)
preview_10 = CustomPreview(Geometry=benches, Material=benches_2)
preview_11 = CustomPreview(Geometry=pier, Material=pier_2)
preview_12 = CustomPreview(Geometry=flower_beds, Material=beds)
preview_13 = CustomPreview(Geometry=pavilion.shell, Material=shell)
preview_14 = CustomPreview(Geometry=columns, Material=columns_2)
